# Grasshopper definition brukasse fra linjer.gh (Grasshopper 1.0.7)
# plug-ins: HAL for Grasshopper

sessionsettings = SessionSettings()  # -> Data, DefaultSettings
horisontal_avstand_vertikal_avstand = Panel("""0.000, -0.080
1.226, -1.717
1.001, -0.610
-1.500, -0.475
-3.499, -0.535
-4.000, -0.760
-4.226, -1.867""")
horisontal_avstand_vertikal_avstand_2 = Panel("""1.291, -1.581
1.999, -0.491
0.000, -0.380
0.000, -0.080""")
horisontal_avstand_vertikal_avstand_3 = Panel("""0.000, -0.080
0.000, -0.380
-1.000, -0.490
-1.292, -1.581""")

# ---- group: Ledelinjer
curve = Curve(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)

# ---- group: Kant venstre
curve_2 = Curve(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)

# ---- group: Kant høyre
curve_3 = Curve(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)

# ----
entwine = Entwine(Branch00=curve, Branch01=curve_2, Branch02=curve_3, FlattenInputs=True)

# ---- group: Hent ut forskyvninger vertikalt og horisontalt.
# Info: Bruker Tekst her i csv-format for å viser at dette eventuelt kan leses fra en tabell.
entwine_2 = Entwine(
    Branch00=horisontal_avstand_vertikal_avstand,
    Branch01=horisontal_avstand_vertikal_avstand_2,
    Branch02=horisontal_avstand_vertikal_avstand_3,
    FlattenInputs=True)
text = Text(entwine_2)
text_split = TextSplit(Text=text, Separators=",")  # -> simplify(Result)
list_item = ListItem(List=text_split, Index=0, Wrap=True)  # -> Item, Item1

# ---- group: Lag nye plan langs ledelinjen med normal fra tangenter i xy-plan.
divide_curve = DivideCurve(Curve=curve, Count=Slider(95, range=0..100), Kinks=False)  # -> Points, Tangents, Parameters
c_script = CSharpScript(tangent=divide_curve.Tangents)  # -> rettTangent, CrossProdZ; inputs tangent: Vector3d
# ---------- c_script: C# ----------
    Vector3d zVec = Vector3d.ZAxis; // Create a global Z-vector {0,0,1}

    Vector3d cp = Vector3d.CrossProduct(tangent, Vector3d.ZAxis); // Finner kryss-produkt mellom tangent og global z-vector
    Vector3d rt = new Vector3d(tangent.X, tangent.Y, 0); // projiserer tangent til xy-plan


    // output
    rettTangent = rt;
    CrossProdZ = cp;
# ---------- end c_script ----------
plane_normal = PlaneNormal(Origin=divide_curve.Points, ZAxis=c_script.rettTangent)

# ---- group: Forleng kurve med 1% av opprinnelig lengde
curve_4 = Curve(entwine)
length = Length(Curve=curve_4)
multiplication = Multiplication(A=length, B="0.1")
extend_curve = ExtendCurve(Curve=curve_4, Type=0, Start=multiplication, End=multiplication)

# ---- group: Hent ut forskyvninger vertikalt og horisontalt. / z-forskyvning
number = Number(list_item.Item1)

# ---- group: Hent ut forskyvninger vertikalt og horisontalt. / x-forskyvning
number_2 = Number(list_item.Item)

# ---- group: Flytt punkter på ledekurver. / CrossProdZ
vector = Vector(c_script.CrossProdZ)

# ---- group: Flytt punkter på ledekurver.
curve_plane = CurvePlane(Curve=extend_curve, Plane=plane_normal)  # -> simplify(Points), ParamsC, ParamsP
amplitude = Amplitude(CrossProdZ=vector, Amplitude=number_2)
unit_z = UnitZ(Factor=number)
trim_tree = TrimTree(Tree=curve_plane.Points, Depth=1)
match_tree = MatchTree(Tree=amplitude, Guide=number_2)
addition = Addition(A=match_tree, B=unit_z)
c_script_2 = CSharpScript(pts=trim_tree, vecs=addition)  # -> out, A; inputs pts: tree of Point3d, vecs: tree of Vector3d
# ---------- c_script_2: C# ----------
    
    DataTree<Point3d> finalTree = new DataTree<Point3d>(); // initiate empty tree
    
    foreach (GH_Path path in vecs.Paths)
    {
      var inds = path.Indices; // Path for the vectors
      List<Vector3d> branchVecs = vecs.Branch(path);
      List<Point3d> branchPts = pts.Branch(inds[0]);
      
      List<Point3d> movedPts = new List<Point3d>(); // initiate empty list for moved points
      // Iterate through the two branches
      for (int i = 0; i < branchVecs.Count; i++)
      {
        movedPts.Add( Point3d.Add( branchPts[i], branchVecs[i] ) );
      }
      // add the moved points list to the tree
      finalTree.AddRange(movedPts, path);
      
    }
    A = finalTree;
# ---------- end c_script_2 ----------
path_mapper = PathMapper(c_script_2.A, source="{A;B}(i)", target="{A;i}")

# ---- group: Sorter punkter i riktig rekkefølge
split_tree = SplitTree(Data=path_mapper, Masks=flatten("{0;*}"))  # -> Positive, Negative
split_tree_2 = SplitTree(Data=split_tree.Negative, Masks=flatten("{1;*}"))  # -> Positive, Negative
split_list = SplitList(List=split_tree.Positive, Index="1")  # -> ListA, ListB
match_tree_2 = MatchTree(Tree=split_list.ListA, Guide=split_tree.Positive)
match_tree_3 = MatchTree(Tree=split_list.ListB, Guide=split_tree.Positive)
match_tree_4 = MatchTree(Tree=split_tree_2.Positive, Guide=split_tree.Positive)
match_tree_5 = MatchTree(Tree=split_tree_2.Negative, Guide=split_tree.Positive)
merge = Merge(Data1=match_tree_2, Data2=match_tree_5, Data3=match_tree_3, Data4=match_tree_4, Data5=match_tree_2)  # -> simplify(Result)
polyline = PolyLine(Vertices=merge, Closed=invert(False))

# ---- group: Sorter punkter i riktig rekkefølge / Generer Brep
loft = Loft(
    Curves=flatten(polyline),
    Options={Adjust=False, Closed=False, LoftEnds=0, LoftSimp=0, LoftType=0, Rebuild=10, Refit=0.01})
cap_holes = CapHoles(Brep=loft)
